# Grasshopper definition Appserver2.gh (Grasshopper 1.0.7)
# Uses the multipipe component to create a mesh lattice.

# HOUSE POSITION
number_slider = Slider(8, range=8..20)

# ---- group: Size of panel(cm)
number_slider_2 = Slider(122, range=0..122)
number_slider_3 = Slider(0, range=0..20)

# ----
no_of_panels_1 = GetInteger(number_slider, AtLeast=1, AtMost=2147483647, Maximum=359, Minimum=0)
no_of_panels_2 = GetInteger(Slider(8, range=8..20), AtLeast=1, AtMost=2147483647, Maximum=359, Minimum=0)
series = Series(Start=number_slider_3, Step=number_slider_2, Count=no_of_panels_1)
series_2 = Series(Start=number_slider_3, Step=number_slider_2, Count=no_of_panels_2)
sort = SortList(Keys=series_2)  # -> Keys, ValuesA
sort_2 = SortList(Keys=series)  # -> Keys, ValuesA
pt = Point(Point(1170, 3493, 0))
rev = ReverseList(List=sort.Keys)
rev_2 = ReverseList(List=sort_2.Keys)
get_point = GetPoint(pt, AtLeast=1, AtMost=2147483647, Realtime=True)
item = ListItem(List=rev, Index=0, Wrap=True)
item_2 = ListItem(List=rev_2, Index=0, Wrap=True)
division = Division(A=item, B=2)
division_2 = Division(A=item_2, B=2)
box = CenterBox(Base=get_point, X=division, Y=division_2, Z="150")
pdecon = Deconstruct(Point=get_point)  # -> XComponent, YComponent, ZComponent
Z = UnitZ(Factor="150")
pt_2 = ConstructPoint(XCoordinate=pdecon.XComponent, YCoordinate=pdecon.YComponent, ZCoordinate=0)
move = Move(Geometry=box, Motion=Z)  # -> Geometry, Transform
rotation = GetInteger(Slider(0, range=0..359), AtLeast=1, AtMost=2147483647, Maximum=359, Minimum=0)
rotate = Rotate(Geometry=move.Geometry, Angle=degrees(rotation), Plane=pt_2)  # -> Geometry, Transform
weld = WeldMesh(Mesh=rotate.Geometry, Angle=3.141592654)

# ---- group: Cheap Occlusion
demesh = DeconstructMesh(Mesh=weld)  # -> Vertices, Faces, Colours, Normals
amp = Amplitude(Vector=demesh.Normals, Amplitude="0.1")
addition = Addition(A=demesh.Vertices, B=amp)
meshray = MeshRay(Mesh=weld, Point=addition, Direction=amp)  # -> Point, Hit
gradient = Gradient(LowerLimit=0, UpperLimit=1, Parameter=meshray.Hit, stops=[0: RGB(235, 235, 235), 1: RGB(0, 0, 0)])
mcol = MeshColours(Mesh=weld, Colours=gradient)  # -> flatten(Mesh)
mblur = BlurMesh(Mesh=mcol, Iterations=Slider(5, range=0..5))

# ----
mesh = Mesh(mblur)
M = MeshToBase64Draco(mesh=mesh)  # -> base64Draco; inputs mesh: Mesh
# ---------- M: C# ----------
    var options = new Rhino.FileIO.DracoCompressionOptions();
    options.CompressionLevel = 5;
    options.IncludeTextureCoordinates = false;
    options.IncludeVertexColors = false;

    var compressed = Rhino.FileIO.DracoCompression.Compress(mesh, options);
    base64Draco = compressed.ToBase64String();
# ---------- end M ----------

# ---- group: RH_OUT:walls
txt = Text(M)
