# Grasshopper definition Assignment.3.4.5.gh (Grasshopper 1.0.7)

pt = ConstructPoint(XCoordinate=0, YCoordinate=0, ZCoordinate=0)
sph = Sphere(Base=pt, Radius=Slider(10, range=1..20))
loops = GetNumber(Slider(48, range=1..100), AtLeast=1, AtMost=2147483647, Maximum=1.797693135e+308, Minimum=-1.797693135e+308)
seed = GetNumber(Slider(1, range=1..5), AtLeast=1, AtMost=2147483647, Maximum=1.797693135e+308, Minimum=-1.797693135e+308)
box = Box(sph)
plane_direction = GetNumber(Slider(6, range=1..10), AtLeast=1, AtMost=2147483647, Maximum=1.797693135e+308, Minimum=-1.797693135e+308)
pop3d = Populate3D(Region=box, Count=loops, Seed=seed)
ln = Line(StartPoint=pt, EndPoint=pop3d)
division = Division(A=plane_direction, B=10)
pframe = PerpFrame(Curve=ln, Parameter=division)

# ---- group: RH_OUT:Edges
sec = BrepPlane(Brep=sph, Plane=pframe)  # -> Curves, Points
